# Grasshopper definition BHoM_Intro_GH_EtabsToRevit.gh (Grasshopper 1.0.7)
# plug-ins: BH.UI.Grasshopper

# ---- group: Create Adapter to Pull From
# PULL BHOM OBJECTS
etabs_filepath = FilePath("C:\Users\enarhi\OneDrive - BuroHappold\Desktop\StanfordAEC\2021\BHoM Demo\BHoM_Intro_ETABS_Example_08.EDB")
connect_to_etabs = BooleanToggle(False)
etabs17adapter = ETABS17Adapter(FilePath=etabs_filepath, Active=connect_to_etabs, Component="{ ..ctor")
adapter = Data(etabs17adapter)

# ---- group: Pull Bars (Beams and Columns)
createtype = CreateType(Component="BH.oM.Structure.Elements.Bar")
pull_bars = BooleanToggle(True)
filterrequest = FilterRequest(Type=createtype, Component="{ .FilterRequest")
adapter_2 = Data(adapter)
pull = Pull(
    Adapter=adapter_2,
    Request=filterrequest,
    PullType="{ \"_t\" : \"System.Enum\", \"TypeName\" : { \"_t\" : \"System.Type\", \"Name\" : \"BH.oM.Adapter.PullType\" }, \"Value\" : \"AdapterDefault\" }",
    Active=pull_bars,
    Component="{ .Pull")

# ---- group: Pull Panels (Walls and Floors)
createtype_2 = CreateType(Component="BH.oM.Structure.Elements.Panel")
pull_panels = BooleanToggle(True)
filterrequest_2 = FilterRequest(Type=createtype_2, Component="{ .FilterRequest")
adapter_3 = Data(adapter)
pull_2 = Pull(
    Adapter=adapter_3,
    Request=filterrequest_2,
    PullType="{ \"_t\" : \"System.Enum\", \"TypeName\" : { \"_t\" : \"System.Type\", \"Name\" : \"BH.oM.Adapter.PullType\" }, \"Value\" : \"AdapterDefault\" }",
    Active=pull_panels,
    Component="{ .Pull")

# ---- group: Create Levels (To Snap to / Create in Revit)
level_elevations = Panel("""0
4
8""")
level_names = Panel("""GROUND LEVEL
LEVEL 1
LEVEL 2""")
level = Level(Elevation=level_elevations, Name=level_names, Component="{ .Level")
bhom_levels = BHoMObject(
    level,
    ObjectType="{ \"_t\" : \"System.Type\", \"Name\" : \"System.Object, mscorlib, Version=4.0.0.0, Culture=neutral, PublicKeyToken=b77a5c561934e089\" }",
    m_ForcePreview=False,
    m_MaxItemsPreview=10000)

# ----
bhom_panels = BHoMObject(
    pull_2,
    ObjectType="{ \"_t\" : \"System.Type\", \"Name\" : \"System.Object, mscorlib, Version=4.0.0.0, Culture=neutral, PublicKeyToken=b77a5c561934e089\" }",
    m_ForcePreview=False,
    m_MaxItemsPreview=10000)
bhom_bars = BHoMObject(
    pull,
    ObjectType="{ \"_t\" : \"System.Type\", \"Name\" : \"System.Object, mscorlib, Version=4.0.0.0, Culture=neutral, PublicKeyToken=b77a5c561934e089\" }",
    m_ForcePreview=False,
    m_MaxItemsPreview=10000)

bhom_bars_2 = BHoMObject(
    bhom_bars,
    ObjectType="{ \"_t\" : \"System.Type\", \"Name\" : \"System.Object, mscorlib, Version=4.0.0.0, Culture=neutral, PublicKeyToken=b77a5c561934e089\" }",
    m_ForcePreview=False,
    m_MaxItemsPreview=10000)
bhom_panels_2 = BHoMObject(
    bhom_panels,
    ObjectType="{ \"_t\" : \"System.Type\", \"Name\" : \"System.Object, mscorlib, Version=4.0.0.0, Culture=neutral, PublicKeyToken=b77a5c561934e089\" }",
    m_ForcePreview=False,
    m_MaxItemsPreview=10000)

# ---- group: Geometry Cleanup / Modification (As Required)
# MODIFY BHOM OBJECTS
geometry = Geometry(Link=bhom_bars_2, Component="{ .Geometry")
geometry_2 = Geometry(Panel=bhom_panels_2, Component="{ .Geometry")
bhom_levels_2 = BHoMObject(
    bhom_levels,
    ObjectType="{ \"_t\" : \"System.Type\", \"Name\" : \"System.Object, mscorlib, Version=4.0.0.0, Culture=neutral, PublicKeyToken=b77a5c561934e089\" }",
    m_ForcePreview=False,
    m_MaxItemsPreview=10000)
snap_tol = Slider(1, range=0..1)
cluster = Cluster(geo_to_snap=geometry, level_planes=bhom_levels_2, snap_max_dist=snap_tol)  # -> flatten(snapped_crv_2)
cluster_2 = Cluster(geo_to_snap=geometry_2, level_planes=bhom_levels_2, snap_max_dist=snap_tol)  # -> flatten(snapped_crv_2)
line = Line(cluster)
setgeometry = SetGeometry(Link=bhom_bars_2, Curve=line, Component="{ .SetGeometry")

# ----
isetoutlineelements1d = ISetOutlineElements1D(Element2D=graft(bhom_panels_2), NewOutline=graft(cluster_2), Component="{ .ISetOutlineElements1D")  # -> flatten(Element2D)

snapped_bhom_panels = BHoMObject(
    isetoutlineelements1d,
    ObjectType="{ \"_t\" : \"System.Type\", \"Name\" : \"System.Object, mscorlib, Version=4.0.0.0, Culture=neutral, PublicKeyToken=b77a5c561934e089\" }",
    m_ForcePreview=False,
    m_MaxItemsPreview=10000)
snapped_bhom_bars = BHoMObject(
    setgeometry,
    ObjectType="{ \"_t\" : \"System.Type\", \"Name\" : \"System.Object, mscorlib, Version=4.0.0.0, Culture=neutral, PublicKeyToken=b77a5c561934e089\" }",
    m_ForcePreview=False,
    m_MaxItemsPreview=10000)

# ---- group: Apply Default Section Property if Property is Null
snapped_bhom_bars_2 = BHoMObject(
    snapped_bhom_bars,
    ObjectType="{ \"_t\" : \"System.Type\", \"Name\" : \"System.Object, mscorlib, Version=4.0.0.0, Culture=neutral, PublicKeyToken=b77a5c561934e089\" }",
    m_ForcePreview=False,
    m_MaxItemsPreview=10000)
default_section_to_use = Panel("W12X22")
getproperty = GetProperty(Obj=snapped_bhom_bars_2, PropName="SectionProperty", Component="{ .GetProperty")
match = Match(LibraryName="W", PropertyName="Name", Value=default_section_to_use, Component="{ .Match")
cleanname = CleanName(obj=getproperty)
null = NullItem(Item=cleanname)  # -> NullFlags, InvalidFlags, Description
long = LongestList(ListA=null.NullFlags, ListB=cleanname, ListC=match, PaddingMode=2)  # -> ListA, ListB, ListC
p_n_c = PickNChoose(Pattern=long.ListA, Stream0=long.ListB, Stream1=long.ListC)
# CONVERT BHOM OBJECTS TO
# PHYSICAL ELEMENTS FOR REVIT
setproperty = SetProperty(Obj=snapped_bhom_bars_2, PropName="SectionProperty", Value=p_n_c, Component="{ .SetPropertyValue")

# ---- group: Split Floors and Walls
snapped_bhom_panels_2 = BHoMObject(
    snapped_bhom_panels,
    ObjectType="{ \"_t\" : \"System.Type\", \"Name\" : \"System.Object, mscorlib, Version=4.0.0.0, Culture=neutral, PublicKeyToken=b77a5c561934e089\" }",
    m_ForcePreview=False,
    m_MaxItemsPreview=10000)
normal = Normal(Element2D=snapped_bhom_panels_2, Component="{ .Normal")
flr_normal_threshold = Slider(0.2, range=0..1)
devec = DeconstructVector(Vector=normal)  # -> XComponent, YComponent, ZComponent
abs = Absolute(Value=devec.ZComponent)
larger = LargerThan(FirstNumber=abs, SecondNumber=flr_normal_threshold)  # -> LargerThan, OrEqualTo
dispatch = Dispatch(List=snapped_bhom_panels_2, DispatchPattern=larger.LargerThan)  # -> ListA, ListB

# ----
snapped_bhom_floors = BHoMObject(
    dispatch.ListA,
    ObjectType="{ \"_t\" : \"System.Type\", \"Name\" : \"System.Object, mscorlib, Version=4.0.0.0, Culture=neutral, PublicKeyToken=b77a5c561934e089\" }",
    m_ForcePreview=False,
    m_MaxItemsPreview=10000)
snapped_bhom_walls = BHoMObject(
    dispatch.ListB,
    ObjectType="{ \"_t\" : \"System.Type\", \"Name\" : \"System.Object, mscorlib, Version=4.0.0.0, Culture=neutral, PublicKeyToken=b77a5c561934e089\" }",
    m_ForcePreview=False,
    m_MaxItemsPreview=10000)

snapped_bhom_bars_3 = BHoMObject(
    setproperty,
    ObjectType="{ \"_t\" : \"System.Type\", \"Name\" : \"System.Object, mscorlib, Version=4.0.0.0, Culture=neutral, PublicKeyToken=b77a5c561934e089\" }",
    m_ForcePreview=False,
    m_MaxItemsPreview=10000)

# ---- group: Create Floors and Walls for Revit
default_floor_type_to_use_if_not_specifi = Panel("Concrete Slab 6\"")  # "Default Floor Type To Use If Not Specified"
default_wall_type_to_use_if_not_specifie = Panel("Concrete 6\"")  # "Default Wall Type To Use If Not Specified"
internalelementcurves = InternalElementCurves(Element2D=snapped_bhom_floors, Recursive=True, Component="{ .InternalElementCurves")
externalelementcurves = ExternalElementCurves(Element2D=snapped_bhom_floors, Recursive=True, Component="{ .ExternalElementCurves")
internalelementcurves_2 = InternalElementCurves(Element2D=snapped_bhom_walls, Recursive=True, Component="{ .InternalElementCurves")
externalelementcurves_2 = ExternalElementCurves(Element2D=snapped_bhom_walls, Recursive=True, Component="{ .ExternalElementCurves")
getproperty_2 = GetProperty(Obj=snapped_bhom_floors, PropName="Property.Name", Component="{ .GetProperty")
getproperty_3 = GetProperty(Obj=snapped_bhom_walls, PropName="Property.Name", Component="{ .GetProperty")
null_2 = NullItem(Item=getproperty_2)  # -> NullFlags, InvalidFlags, Description
null_3 = NullItem(Item=getproperty_3)  # -> NullFlags, InvalidFlags, Description
long_2 = LongestList(ListA=null_2.NullFlags, ListB=getproperty_2, ListC=default_floor_type_to_use_if_not_specifi, PaddingMode=2)  # -> ListA, ListB, ListC
long_3 = LongestList(ListA=null_3.NullFlags, ListB=getproperty_3, ListC=default_wall_type_to_use_if_not_specifie, PaddingMode=2)  # -> ListA, ListB, ListC
join = JoinCurves(Curves=externalelementcurves_2, Preserve=False)
join_2 = JoinCurves(Curves=externalelementcurves, Preserve=False)
p_n_c_2 = PickNChoose(Pattern=long_2.ListA, Stream0=long_2.ListB, Stream1=long_2.ListC)
p_n_c_3 = PickNChoose(Pattern=long_3.ListA, Stream0=long_3.ListB, Stream1=long_3.ListC)
construction = Construction(Name=p_n_c_3, Component="{ .Construction")
wall = Wall(Construction=graft(construction), Edges=join, InternalEdges=internalelementcurves_2, Component="{ .Wall")
construction_2 = Construction(Name=p_n_c_2, Component="{ .Construction")
floor = Floor(Construction=simplify(graft(construction_2)), Edges=join_2, InternalEdges=internalelementcurves, Component="{ .Floor")
bhom_floors_and_walls = BHoMObject(
    flatten([floor, wall]),
    ObjectType="{ \"_t\" : \"System.Type\", \"Name\" : \"System.Object, mscorlib, Version=4.0.0.0, Culture=neutral, PublicKeyToken=b77a5c561934e089\" }",
    m_ForcePreview=False,
    m_MaxItemsPreview=10000)
clean = CleanTree(RemoveNulls=True, RemoveInvalid=True, RemoveEmpty=False, Tree=bhom_floors_and_walls)

# ---- group: Create Framing Elems For Revit
structuralusage1d = StructuralUsage1D(
    {"Undefined": 0, "Beam": 1, "Column": 2, "Brace": 3, "Cable": 4, "Pile": 5}, selected="Column",
    Component="BH.oM.Structure.Elements.StructuralUsage1D",
    Selection=2)
structuralusage1d_2 = StructuralUsage1D(
    {"Undefined": 0, "Beam": 1, "Column": 2, "Brace": 3, "Cable": 4, "Pile": 5}, selected="Beam",
    Component="BH.oM.Structure.Elements.StructuralUsage1D",
    Selection=1)
isvertical = IsVertical(Bar=snapped_bhom_bars_3, Component="{ .IsVertical")
long_4 = LongestList(ListA=isvertical, ListB=structuralusage1d, ListC=structuralusage1d_2, PaddingMode=2)  # -> ListA, ListB, ListC
p_n_c_4 = PickNChoose(Pattern=long_4.ListA, Stream0=long_4.ListC, Stream1=long_4.ListB)
framingelement = FramingElement(Bar=snapped_bhom_bars_3, StructuralUsage=p_n_c_4, Component="{ .FramingElement")

# ----
bhom_floors_and_walls_2 = BHoMObject(
    clean,
    ObjectType="{ \"_t\" : \"System.Type\", \"Name\" : \"System.Object, mscorlib, Version=4.0.0.0, Culture=neutral, PublicKeyToken=b77a5c561934e089\" }",
    m_ForcePreview=False,
    m_MaxItemsPreview=10000)
bhom_framingelems = BHoMObject(
    framingelement,
    ObjectType="{ \"_t\" : \"System.Type\", \"Name\" : \"System.Object, mscorlib, Version=4.0.0.0, Culture=neutral, PublicKeyToken=b77a5c561934e089\" }",
    m_ForcePreview=False,
    m_MaxItemsPreview=10000)

# ---- group: Adapter to Send To
connect_to_revit = BooleanToggle(True)
# PUSH BHOM OBJECTS
revitadapter = RevitAdapter(Active=connect_to_revit, Component="{ ..ctor")

# ----
bhom_framingelems_2 = BHoMObject(
    flatten(bhom_framingelems),
    ObjectType="{ \"_t\" : \"System.Type\", \"Name\" : \"System.Object, mscorlib, Version=4.0.0.0, Culture=neutral, PublicKeyToken=b77a5c561934e089\" }",
    m_ForcePreview=False,
    m_MaxItemsPreview=10000)
bhom_panels_3 = BHoMObject(
    flatten(bhom_floors_and_walls_2),
    ObjectType="{ \"_t\" : \"System.Type\", \"Name\" : \"System.Object, mscorlib, Version=4.0.0.0, Culture=neutral, PublicKeyToken=b77a5c561934e089\" }",
    m_ForcePreview=False,
    m_MaxItemsPreview=10000)
bhom_levels_3 = BHoMObject(
    flatten(bhom_levels),
    ObjectType="{ \"_t\" : \"System.Type\", \"Name\" : \"System.Object, mscorlib, Version=4.0.0.0, Culture=neutral, PublicKeyToken=b77a5c561934e089\" }",
    m_ForcePreview=False,
    m_MaxItemsPreview=10000)
bhom_objects_to_send_to_revit = BHoMObject(
    [bhom_framingelems_2, bhom_panels_3, bhom_levels_3],
    ObjectType="{ \"_t\" : \"System.Type\", \"Name\" : \"System.Object, mscorlib, Version=4.0.0.0, Culture=neutral, PublicKeyToken=b77a5c561934e089\" }",
    m_ForcePreview=False,
    m_MaxItemsPreview=10000)
push = BooleanToggle(False)
adapter_4 = Data(revitadapter)
# NOTE: All Types Need to be loaded in Revit before pushing or else the elements will not be created. The type used in Revit is per the Beam/Column SectionProperty Name or the Floor/Wall Construction Name.
push_2 = Push(
    Adapter=adapter_4,
    Objects=flatten(bhom_objects_to_send_to_revit),
    PushType="{ \"_t\" : \"System.Enum\", \"TypeName\" : { \"_t\" : \"System.Type\", \"Name\" : \"BH.oM.Adapter.PushType\" }, \"Value\" : \"AdapterDefault\" }",
    Active=push,
    Component="{ .Push")  # -> Objects, Success

# ==== cluster Cluster
snap_max_dist = ClusterInput()
geo_to_snap = ClusterInput()
level_planes = ClusterInput()
snap_max_dist_2 = Data(snap_max_dist)
geo_to_snap_2 = Data(geo_to_snap)
level_planes_2 = Data(level_planes)
getproperty = GetProperty(Obj=level_planes_2, PropName="Elevation", Component="{ .GetProperty")
disc = Discontinuity(Curve=geo_to_snap_2, Level=1)  # -> simplify(Points), Parameters
pt = ConstructPoint(XCoordinate=0, YCoordinate=0, ZCoordinate=getproperty)
data = Data(disc.Points)
xy = XYPlane(Origin=pt)
cp = PlaneClosestPoint(Point=graft(data), Plane=xy)  # -> Point, UVPoint, Distance
abs = Absolute(Value=cp.Distance)
sort = SortList(Keys=abs, ValuesA=cp.Point)  # -> Keys, ValuesA
item = ListItem(List=sort.ValuesA, Index=0, Wrap=True)
item_2 = ListItem(List=sort.Keys, Index=0, Wrap=True)
smaller = SmallerThan(FirstNumber=item_2, SecondNumber=snap_max_dist_2)  # -> SmallerThan, OrEqualTo
p_n_c = PickNChoose(Pattern=smaller.OrEqualTo, Stream0=data, Stream1=item)  # -> simplify(Result)
cls = Closed(Curve=geo_to_snap_2)  # -> simplify(graft(Closed)), Periodic
trim = TrimTree(Tree=p_n_c, Depth=1)
pline = PolyLine(Vertices=trim, Closed=cls.Closed)
snapped_crv = Curve(pline)
snapped_crv_2 = ClusterOutput(snapped_crv)

# ==== cluster CleanName
obj = ClusterInput()
obj_2 = Data(obj)
getproperty = GetProperty(Obj=obj_2, PropName="Name", Component="{ .GetProperty")
rep = ReplaceText(Text=getproperty, Find=" ", RecursiveReplace=False)
setproperty = SetProperty(Obj=obj_2, PropName="Name", Value=rep, Component="{ .SetPropertyValue")
obj_3 = Data(setproperty)
obj_4 = ClusterOutput(obj_3)
